# Grasshopper definition Speckle Grasshopper - Documentation.gh (Grasshopper 1.0.8)
# plug-ins: Speckle.Connector.Grasshopper

# ---- group: Objects - 1 : Speckle Object
# Use the `Speckle Object` passthrough node to create or mutate Speckle Objects.
# 
# 1. Add an optional Speckle Object (for mutations).
# 2. Add an optional `Geometry` input. Will mutate the input Speckle Object, or create a new Object.
# 3. Add an optional `Name` input. Will mutate the object.
# 4. Add an optional `Properties` input. Will mutate the object.
# 5. Add an optional `Color` input. Will *NOT* mutate the object.
# 6. Add an optional `Material` input. Will *NOT* mutate the object.
# 
# Object mutations will result in a new Application Id for the input Speckle Object if there is one.
colour_swatch = ColourSwatch(SwatchColor=RGB(255, 255, 255))
speckle_properties = SpeckleProperties()
speckle_material = SpeckleMaterial()
# OBJECTS
# Speckle Objects are discrete objects inside a Speckle Model. Most Speckle Objects can be converted natively to Grasshopper/Rhino geometry.
# See the `Speckle Object Param` for more information on behavior in Grasshopper.
speckle_object = SpeckleObject()
geometry = Geometry()
speckle_object_2 = SpeckleObject(Object=speckle_object, Geometry=geometry, Properties=speckle_properties, Color=colour_swatch, Material=speckle_material)  # -> Object, Geometry, Name, Properties, Color, Material, Path

# ---- group: Collections - 1 : Collection Selector
# COLLECTIONS
# Speckle Collections are containers for Speckle Objects. All Speckle Models are structured by Collections, which can represent Layers, Categories, Levels, etc in the source application.
# Speckle Models are Collections themselves. See the `Speckle Collection param` for more information on behavior in Grasshopper.
# Use the `Collection Selector` input node to view all of the sub-Collection paths inside the input Collection.
# 
# 1. Add the required input Collection parameter. This can be the output of the Load nodes.
# 2. You will see all the Collections inside your input Collection by their path (similar to Rhino Layers)
# 3. Left-click to select a Collection path, or shift+left-click to select multiple.
# 4. Double click the `Search` field at the top to filter paths that match the search. Supports regex.
# 
# This node is used as an optional input for the `Query Objects` node
speckle_collection = SpeckleCollection()
collection_selector = CollectionSelector(speckle_collection)

# ---- group: Parameters - 1 : Speckle Collection
# PARAMETERS
# These parameters represent Speckle entities, and are interoperable with native Rhino and Grasshopper entities. Some also contain bake capabilities.
# Speckle Collection Param represents Layers in the Rhino context.
# 
# CASTING:
# - Castable to and from Grasshopper 8 Model Layers.
#   Preserves Name, Color, and Material.
# 
# BAKE:
# - Will create a Layer in the Rhino Document.
#   Uses the full path, Name, Color, and Material of the Collection.
# 
# PREVIEW:
# - Will preview all contained Objects inside the Collection.
speckle_collection_2 = SpeckleCollection()

# ---- group: Dev - 1 : Deconstruct
# Use the `Deconstruct` node to inspect all fields inside a Speckle Param.
# 
# 1. Add a Speckle Object, Speckle Material, Speckle Properties, or Speckle Collection input.
# 2. An output will be generated for every field of the Speckle param.
# 
# This component exposes fields on any Base-derived Speckle entity that isn't convertible to native Rhino/GH.
speckle_properties_2 = SpeckleProperties()
speckle_collection_3 = SpeckleCollection()
# DEV
# Dev components give you additional features, for advanced Speckle and Grasshopper users.
speckle_material_2 = SpeckleMaterial()
speckle_object_3 = SpeckleObject()
deconstruct = Deconstruct(SpeckleParam=[speckle_material_2, speckle_object_3, speckle_collection_3, speckle_properties_2])

# ---- group: Operations - 1 : Speckle Model Link
# Speckle for Grasshopper
# Welcome to the Speckle Next-Gen Grasshopper connector!
# Use these sample files for documentation on each Speckle node, and for example scripts of each core workflow:
# 
# (1) Design Coordination
# (2) Online Presentation
# (3) Business Intelligence
# 
# Speckle for Grasshopper and docs is built and maintained by claire@speckle.systems.
# Reach out on speckle.community for feedback, bug reports, and requests.
# Documentation
# OPERATIONS
# Speckle operations allow you to publish your Grasshopper model to Speckle, or load any model into Grasshopper.
# https://app.speckle.systems/projects/8be1007be1/models/13a2953168
# Use the `Speckle Model Url` input node for all of your account, workspace, and model management.
# 
# 1. Right click node to change Account
# 2. Left click first button to change workspace
# 3. Left click `Select Project` button to select your project
# 3. Left click `Select Model` button to select your model
# 4. By default, the version will be the latest version. Left click node `Version` to select a specific version.
# 
# Alternatively, pipe in a text url copied from your model on the Speckle web app.
# The Project, Model, and Version information will be populated for you automatically.
speckle_model_url = SpeckleModelURL(Server="https://app.speckle.systems", User="B8C2972E1A6094F9A8CCA818CE15D06F", Workspace="848da9ff2c")

# ---- group: Parameters - 2 : Speckle Object
# Speckle Object Param represents entities in the Rhino context.
# Not all Speckle Objects are convertible to Rhino/GH.
# Non-convertible Objects have no casting/baking/preview behavior.
# 
# CASTING:
# - Castable to and from Grasshopper 8 Model Objects.
#   Preserves Name, User Strings, Color, and Material.
# - Castable to and from Geometry
# 
# BAKE:
# - Will create a Geometry object in the Rhino Document in its Layer.
#   Bakes with Name, User Strings, Color, and Material.
#   Layers for the Object Collection path will be created if they do not exist.
#   Material for the Object will be created if it does not exist.
# 
# PREVIEW:
# - Will preview any geometry contained inside the Speckle Object.
speckle_object_4 = SpeckleObject()

# ---- group: Objects - 2 : Filter Objects
# Use the `Filter Objects` node to filter Speckle Objects that match search requirements.
# 
# 1. Add the list of Objects to filter.
# 2. Add an optional `Name` input. Only objects with matching names will remain.
# 3. Add an optional `Property Key` input. Only objects with a matching property will remain.
# 4. Add an optional `Material Name` input. Only objects with matching materials will remain.
# 5. Add an optional `Application Id` input. Only objects with matching applicationId will remain.
# 6. Add an optional `Speckle Id` input. Only objects with matching id will remain.
# 
# Mouseover the input parameters to see match options, including regex searching.
# All objects that don't match the filter requirements will be output in Culled Objects
speckle_object_5 = SpeckleObject()
filter_objects = FilterObjects(Objects=speckle_object_5)  # -> Objects, CulledObjects

# ---- group: Dev - 2 : (Sync) Load
# Use the `(Sync) Load` node to load your Speckle model into Grasshopper.
# 
# 1. Add the required Model Link input from the `Speckle Model Url` node
# 2. Connect a boolean toggle and set to `True`
# 3. Your Speckle model will now load synchronously. Larger models will take longer to load.
# 4. Your loaded model is a Speckle Collection object, previewed by this node.
# 
# *This node will run synchronously.*
# As soon as you toggle `Run` to `True`, your Grasshopper script will freeze until the load is complete.
# Use this node if you are running in an environment that does not support async operations.
boolean_toggle = BooleanToggle(False)
sync_load = SyncLoad(Run=boolean_toggle)

# ---- group: Collections - 2 : Expand Collection
# Use the `Expand Collection` node to get the direct children of the input Collection.
# Direct children can be either other Collections, or Speckle Objects.
# 
# 1. Add the required input Collection parameter. This can be the output of the Load nodes.
# 2. An output parameter will be generated for every sub-collection inside the input Collection.
# 3. A single output will be generated for all Speckle Objects directly inside the input Collection.
# 
# This node can be chained consequtively to retrieve the direct children of any output Collections.
# This is an alternative to the "Collection Selector + Query Objects" nodes.
speckle_collection_4 = SpeckleCollection()
deconstruct_2 = Deconstruct(SpeckleParam=speckle_collection_4)

# ---- group: Operations - 2 : Load
# Use the `Load` node to load your Speckle model into Grasshopper.
# 
# 1. Add the required Model Link input from the Speckle Model Link node (Operations - 1)
# 2. Press the `Load` button
# 3. Right-click node and select `Cancel` to cancel an ongoing Load operation.
# 4. Your loaded Speckle model is a Speckle Collection object, previewed by this node.
# 
# This node will run async: you can continue to use Grasshopper while your model is loading.
# Right click to enable automatic loading of new versions of your model.
# This option is available as long as you do not specify a specific version to load in your Model Link input.
load = Load()

# ---- group: Parameters - 3 : Speckle Properties
# Speckle Properties Param represents user strings in the Rhino context.
# 
# CASTING:
# - Castable from Grasshopper 8 Model Objects.
#   Lets you use the User Text node to create Properties with keyvalues.
# - Castable to and from Dictionary<string, object?>
# 
# BAKE:
# - None
# 
# PREVIEW:
# - None
speckle_properties_3 = SpeckleProperties()

# ---- group: Collections - 3 : Create Collection
# Use `Create Collection` node to create Speckle Collections to structure your Speckle Model.
# 
# 1. This node has variable inputs. Each input will create a sub Collection in the output Collection.
# 2. Right-click any input to change the name of the sub-Collection
# 3. Pipe in Speckle Objects or Speckle Collections into the input. Inputs cannot contain both.
# 4. Remove any empty collections that you don't want
# 
# Tips: Press `TAB` while adding an input to inherit the input nickname.
# Or right-click the node and select `Always Inherit Names` to turn this setting on for all inputs.
# 
# This node is primarily used to create the Speckle Model for publishing to Speckle.
speckle_collection_5 = SpeckleCollection()
speckle_object_6 = SpeckleObject()
create_collection = CreateCollection(SubCollection1=speckle_collection_5, SubCollection2=speckle_object_6, AlwaysInheritNames=False)

# ---- group: Objects - 3 : Query Objects
# Use the `Query Objects` node to retrieve Speckle Objects inside the input Collection.
# 
# 1. Add the required input Collection parameter. This can be the output of the Load nodes.
# 2. By default, all contained Speckle Objects in a flat list (including those in sub Collections).
# 3. If paths are input, the direct Speckle Object children of the path are output in a branch per path.
speckle_collection_6 = SpeckleCollection()
query_objects = QueryObjects(Collection=speckle_collection_6)

# ---- group: Dev - 3 : (Sync) Publish
# Use the `(Sync) Publish` node to publish your GH model to Speckle.
# 
# 1. Add the required Model Link input from the `Speckle Model Url` node
# 2. Add the Speckle model you want to publish
# 2. Connect a boolean toggle and set to `True`
# 3. Your Speckle model will now publish synchronously. Larger models will take longer to publish
# 4. Right-click `View online` to open your published model in your default web browser.
# 
# *This node will run synchronously.*
# As soon as you toggle `Run` to `True`, your GH script will freeze until the publish is complete.
# Use this node if you are running in an environment that does not support async operations.
boolean_toggle_2 = BooleanToggle(False)
speckle_collection_7 = SpeckleCollection()
sync_publish = SyncPublish(Collection=speckle_collection_7, Run=boolean_toggle_2)

# ---- group: Operations - 3 : Publish
# Use the `Publish` node to publish your Grasshopper Speckle model to your Speckle Project.
# 
# 1. Add the required Model Url input from the `Speckle Model Url` node (Operations - 1)
# 2. Add the Speckle model Collection
# 2. Press the `Publish` button
# 3. Right-click node and select `Cancel` to cancel an ongoing Publish operation.
# 4. Right-click node and select `View online` to open your published model in your default browser.
# 
# This node will run async: you can continue to use Grasshopper while your model is publishing
# Right-click to enable automatic publishing whenever this node recomputes.
speckle_collection_8 = SpeckleCollection()
publish = Publish(Collection=speckle_collection_8)

# ---- group: Parameters - 4 : Speckle Material
# Speckle Material Param represents materials in the Rhino/GH context.
# 
# CASTING:
# - Castable to and from GH8 Model Materials.
# - Castable to and from GH8 Render Materials.
# - Castable to and from Display Materials.
# 
# BAKE:
# - Will create a Material in the Rhino Doc with the name of Speckle Material.
#   The Nickname of the param is used when no name exists.
# 
# PREVIEW:
# - None
speckle_material_3 = SpeckleMaterial()

# ---- group: Objects - 4 : Property Selector
# Use the `Property Selector` input node to view all of the properties inside the input Object.
# 
# 1. Add the required input Objects parameter.
# 2. You will see all the Properties inside your input Objects by their keys
# 3. Left-click to select a Property key, or shift+left-click to select multiple.
# 4. Double click the `Search` field at the top to filter keys that match the search. Supports regex.
# 
# This node is used as an input for the `Query Properties` node
speckle_object_7 = SpeckleObject()
property_selector = PropertySelector(speckle_object_7)

# ---- group: Objects - 5: Query Properties
# Use the `Query Properties` node to retrieve the values of properties on Speckle Objects.
# 
# 1. Add the required input Objects parameter.
# 2. Add the required input Keys parameter, from the Property Selector node.
# 3. An output is generated for every input key, with the value of that key on each input Object.
speckle_object_8 = SpeckleObject()
query_properties = QueryProperties(Objects=speckle_object_8)

# ---- group: Objects - 5: Create Properties
# Use `Create Properties` node to create Speckle Properties to add metadata to your Objects.
# 
# 1. This node has variable inputs. Each input will create a Property in the output Properties.
# 2. Right-click any input to change the key of the property
# 3. Inputs can contain any simple types like strings, bools, and numbers.
# 4. Remove any empty properties that you don't want
# 
# Tips: Press `TAB` while adding an input to inherit the input nickname.
# Or right-click the node and select `Always Inherit Names` to turn this setting on for all inputs.
# 
# The output of this node is used for the `Speckle Object` node.
number = Number()
boolean = Boolean()
text = Text()
create_properties = CreateProperties(Property1=number, Property2=text, Property3=boolean, AlwaysInheritNames=False, CreateEmptyProperties=False)
