# Grasshopper definition Speckle Grasshopper - Sample Scripts.gh (Grasshopper 1.0.8)
# plug-ins: Speckle.Connector.Grasshopper

# ---- group: STEP 1 : Get Speckle model link
# STEP 1
# 
# Get a link to any Speckle model.
# This sample script is linking to our demo Speckle Revit model.
# Copy paste the url in your browser to see the model online.
panel = Panel("https://app.speckle.systems/projects/8be1007be1/models/13a2953168")
speckle_model_url = SpeckleModelURL(SpeckleUrl=panel, Server="https://next.speckle.dev", User="F59D3E3267614EE8E8B6421D8EB51012")

# ---- group: STEP 1 : Define inputs / Inputs
# Speckle for Grasshopper
# Welcome to the Speckle Next-Gen Grasshopper connector!
# Use this sample file for example scripts of each core workflow:
# 
# (1) Design Coordination
# (2) Online Presentation
# (3) Business Intelligence
# 
# Speckle for Grasshopper and docs is built and maintained by bjorn@speckle.systems.
# Reach out on speckle.community for feedback, bug reports, and requests.
# Sample Script - Design Coordination
# https://www.speckle.systems/use-cases/design-coordination
# Generate a facade model for your collaborators to use as a reference in their apps
# This is a sample script to generate a facade for your collaborators to load in their applications.
# Structure your model for good collaboration!
# 
# This script will create a randomized facade, calculate panel properties, and sort facade panels into collections by level.
# After publishing, copy and paste the link to your collaborators so they can load your model in Rhino, Revit, and more!
# STEP 1
# 
# Define your input parameters.
# Here we'll create a simple randomized panel wall.
facade_length = Panel("55")
panel_width = Panel("3.6")
total_height = Panel("50")
level_heights = Number([0, 12, 9, 9, 9])

# ---- group: STEP 2 : Calculate levels
# STEP 2
# 
# Using native components, calculate your Level elevations.
# We'll use this later to store as a property on each panel.
cluster = Cluster(A=facade_length, step=panel_width, B=panel_width, list=level_heights, input=level_heights)  # -> series_3, length, random_2, partial_results
levels = Number(cluster.partial_results)

# ---- group: STEP 2 : Load your model
# STEP 2
# 
# Load your model by clicking `Load`.
load = Load(SpeckleModel=speckle_model_url, AutoReceive=False)  # -> Collection, Properties

# ---- group: STEP 3 : Calculate heights
# STEP 3
# 
# Using native components, calculate your Panel Heights.
# We'll use this later to store as a property on each panel.
cluster_2 = Cluster_3(list=levels, item=total_height, indices=cluster.length, B=levels)  # -> result, unit_vector

# ---- group: STEP 3 : Calculate heights / Panel Height
number = Number(cluster_2.result)

# ---- group: Unit conversion factor between from Rhino doc units
panel_2 = Panel("0.01")

# ---- group: STEP 4 : Generate geometry
# STEP 4
# 
# Generate the panel geometry
cluster_3 = Cluster_2(x_coordinate=cluster.series_3, y_coordinate=cluster.random_2, z_coordinate=levels)
extrude = Extrude(Base=cluster_3, Direction=cluster_2.unit_vector)
geometry = Geometry(simplify(extrude))

# ----
# Sample Script - Presentation
# https://www.speckle.systems/use-cases/online-collaboration
# Create a data visualisation of materials in a Revit model to share in the web
# This is a sample script to assign custom materials to a Grasshopper model to convey important information.
# Present and share your models online!
# 
# This script will colorize the Concrete objects in your Revit model in red and everything else is made translucent. All object properties are cleansed, leaving just the volume.
panel_3 = Panel("m3")
create_material = CreateMaterial(
    Diffuse=ColourSwatch(SwatchColor=RGB(219, 219, 219)),
    Specular=RGB(255, 255, 255),
    Emission=RGB(0, 0, 0),
    Transparency=Slider(0.8, range=0..1),
    Shine=0)
create_material_2 = CreateMaterial(
    Diffuse=ColourSwatch(SwatchColor=RGB(242, 61, 24)),
    Specular=RGB(255, 255, 255),
    Emission=RGB(0, 0, 0),
    Transparency=Slider(0.1, range=0..1),
    Shine=0)

# ---- group: STEP 5 : Create Speckle objects
# STEP 5
# 
# Create Speckle Geometry using:
# - a custom set of dimensional properties from the params used to generate the panel geometry
# - a custom material.
colour_swatch = ColourSwatch(SwatchColor=RGB(186, 233, 255))
create_properties = CreateProperties(LevelElevation=levels, PanelHeight=number, PanelWidth=panel_width, AlwaysInheritNames=False, CreateEmptyProperties=False)  # -> simplify(graft(Properties))
create_material_3 = CreateMaterial(Diffuse=colour_swatch, Specular=RGB(255, 255, 255), Emission=RGB(0, 0, 0), Transparency="0.7", Shine=0)

# ----
speckle_geometry = SpeckleGeometry(Geometry=geometry, Properties=create_properties, Material=create_material_3, HasApplicationIdParam=False)  # -> SpeckleGeometry, Geometry, Name, Properties, Color, Material, Path

# ---- group: STEP 6 : Create collections
# STEP 6
# 
# Create a collection for each level and
# place the corresponding speckle geometry into their collections.
explode_tree = ExplodeTree(Data=speckle_geometry.SpeckleGeometry)  # -> Branch0, Branch1, Branch2, Branch3, Branch4
create_collection = CreateCollection(
    Level1=explode_tree.Branch0,
    Level2=explode_tree.Branch1,
    Level3=explode_tree.Branch2,
    Level4=explode_tree.Branch3,
    Level5=explode_tree.Branch4,
    AlwaysInheritNames=False)

# ---- group: STEP 7 : Publish!
# STEP 7
# 
# Publish your model
# https://app.speckle.systems/projects/[projectid]/models/[modelid]
speckle_model_url_2 = SpeckleModelURL(Server="https://app.speckle.systems", User="D5A7B6988F0BE489C659186377199850", Workspace="cf09b9fc90")

# ----
publish = Publish(SpeckleModel=speckle_model_url_2, Collection=create_collection)  # -> SpeckleModel, VersionID

# ---- group: STEP 7 : Publish!
# STEP 7
# 
# Select a Speckle Model to publish to, or use the provided Public Grasshopper project.
# Once published, right-click the Publish node.
# This will open up your model in your web browser :)
# https://app.speckle.systems/projects/[project id]/models/[model id]
speckle_model_url_3 = SpeckleModelURL(Server="https://next.speckle.dev", User="F59D3E3267614EE8E8B6421D8EB51012", Workspace="edf8b0bf67")

# ---- group: STEP 3 : Create new Properties from Volume
# STEP 3
# 
# Retrieve all of the objects inside your model.
# Calculate the volume for the geometries of each object using native GH components, converting from doc units to meters cubed.
# Create Speckle Properties for each geometry with the volume and units.
# Use the Speckle Geometry passthrough node to set these new Properties on your objects.
query_speckle_objects = QuerySpeckleObjects(Collection=load.Collection)

# ----
speckle_geometry_2 = SpeckleGeometry(SpeckleGeometry=query_speckle_objects, HasApplicationIdParam=False)  # -> SpeckleGeometry, Geometry, Name, Properties, Color, Material, Path
cluster_4 = Cluster_4(geometry=speckle_geometry_2.Geometry, A=panel_2)

# ---- group: STEP 3 : Create new Properties from Volume (continued)
create_properties_2 = CreateProperties(Volume=cluster_4, Units=panel_3, AlwaysInheritNames=False, CreateEmptyProperties=False)
speckle_geometry_3 = SpeckleGeometry(SpeckleGeometry=speckle_geometry_2.SpeckleGeometry, Properties=create_properties_2, HasApplicationIdParam=False)  # -> SpeckleGeometry, Geometry, Name, Properties, Color, Material, Path

# ----
speckle_geometry_4 = SpeckleGeometry(flatten(speckle_geometry_3.SpeckleGeometry))

# ---- group: STEP 4 : Sort Objects into Concrete and non-Concrete
# STEP 4
# 
# Filter the objects for Concrete material.
# This component will sort the input objects into those that match the search queries
panel_4 = Panel("?Concrete")

# ----
filter_objects = FilterObjects(Objects=speckle_geometry_4, MaterialName=panel_4)  # -> Objects, CulledObjects

# ---- group: STEP 4 : Sort Objects into Concrete and non-Concrete (continued)
speckle_geometry_5 = SpeckleGeometry(filter_objects.Objects)
speckle_geometry_6 = SpeckleGeometry(filter_objects.CulledObjects)

# ----
# STEP 5
# 
# Create a translucent material to apply to non-concrete objects.
# Create a red material to apply to concrete objects.
# Then override the material and properties of all objects.
speckle_geometry_7 = SpeckleGeometry(SpeckleGeometry=speckle_geometry_5, Material=create_material_2, HasApplicationIdParam=False)  # -> SpeckleGeometry, Geometry, Name, Properties, Color, Material, Path
speckle_geometry_8 = SpeckleGeometry(SpeckleGeometry=speckle_geometry_6, Material=create_material, HasApplicationIdParam=False)  # -> SpeckleGeometry, Geometry, Name, Properties, Color, Material, Path

# ---- group: STEP 6 : Create Collections
# STEP 6
# 
# Create a collection for the concrete objects, named "Concrete".
# Create a collection for all other objects, named "Other".
# Add your objects into their respective Collection.
create_collection_2 = CreateCollection(Concrete=speckle_geometry_7.SpeckleGeometry, Other=speckle_geometry_8.SpeckleGeometry, AlwaysInheritNames=False)

# ----
publish_2 = Publish(SpeckleModel=speckle_model_url_3, Collection=create_collection_2)  # -> SpeckleModel, VersionID

# ==== cluster Cluster
list = ClusterInput()
A = ClusterInput()
B = ClusterInput()
input = ClusterInput()
list_length = ListLength(List=list)
division = Division(A=A, B=B)
step = ClusterInput()
mass_addition = MassAddition(Input=input)  # -> Result, PartialResults
series = Series(Start=0, Step=1, Count=list_length)
random = Random(Range=Domain(-1.2, 1.2), Number=division, Seed=simplify(graft(series)))
series_2 = Series(Start=0, Step=step, Count=division)
length = ClusterOutput(list_length)
random_2 = ClusterOutput(random)
partial_results = ClusterOutput(mass_addition.PartialResults)
series_3 = ClusterOutput(series_2)

# ==== cluster Cluster_2
x_coordinate = ClusterInput()
y_coordinate = ClusterInput()
z_coordinate = ClusterInput()
construct_point = ConstructPoint(XCoordinate=x_coordinate, YCoordinate=y_coordinate, ZCoordinate=simplify(graft(z_coordinate)))
list_length = ListLength(List=construct_point)
shift_list = ShiftList(List=construct_point, Shift=1, Wrap=False)
subtraction = Subtraction(A=list_length, B=1)
cull_index = CullIndex(List=construct_point, Indices=subtraction, Wrap=False)  # -> simplify(List)
line = Line(StartPoint=cull_index, EndPoint=shift_list)  # -> simplify(Line)
line_2 = ClusterOutput(line)

# ==== cluster Cluster_3
list = ClusterInput()
item = ClusterInput()
indices = ClusterInput()
B = ClusterInput()
insert_items = InsertItems(List=list, Item=item, Indices=indices, Wrap=True)
shift_list = ShiftList(List=insert_items, Shift=1, Wrap=False)
subtraction = Subtraction(A=shift_list, B=B)
unit_z = UnitZ(Factor=subtraction)  # -> graft(UnitVector)
result = ClusterOutput(subtraction)
unit_vector = ClusterOutput(unit_z)

# ==== cluster Cluster_4
geometry = ClusterInput()
A = ClusterInput()
volume = Volume(Geometry=geometry)  # -> Volume, Centroid
power = Power(A=A, B=3)
multiplication = Multiplication(A=volume.Volume, B=power)  # -> simplify(graft(Result))
result = ClusterOutput(multiplication)
